# Grasshopper definition ExampleFile.gh (Grasshopper 1.0.8)
# plug-ins: ParkingDemo

curve = Curve(<curve referenced from the Rhino model>)
curve_2 = Curve(<curve referenced from the Rhino model>)
start_generation = StartGeneration(Outline=curve_2, ExcludeBoundaries=curve, AddRamp=False, EntranceSide=2, GenerationInterval=1000, WasRunning=True)
sortresults = SortResults(ResetGeneration=Toggle(False), Parking=start_generation)  # -> Parking, GenerationCollection
deconstruct_parking_collection = DeconstructParkingCollection(GenerationCollection=sortresults.GenerationCollection)  # -> Ids, Scores
list_item = ListItem(List=deconstruct_parking_collection.Ids, Index=Slider(0, range=0..30), Wrap=True)
boolean_toggle = BooleanToggle(True)
selectparking = SelectParking(Generations=sortresults.GenerationCollection, ParkingId=list_item)
block_instance = BlockInstance(<block instance referenced from the Rhino model>)
export_top_parking_options = ExportTopParkingOptions(GenerationCollection=sortresults.GenerationCollection, CarBlock=block_instance, TopCount="20", PNGWidth=2000)  # -> SelectedOptions, Scores
preview_parking_result = PreviewParkingResult(
    Parking=selectparking,
    CarBlock=block_instance,
    BakeCars=boolean_toggle,
    BakeGradientCells=boolean_toggle,
    BakePath=boolean_toggle,
    BakeExcludedCells=boolean_toggle,
    BakeEntranceCell=boolean_toggle,
    BakeWalls=boolean_toggle)
